# Dynamo custom node OpenDirectory.dyf (Dynamo 2.0.1.5055)
# category: Morpheus.Utility
# Opens windows explorer at specified directory.

DirectoryPath = Input(DirectoryPath: string)
python_script = Python(IN[0]=DirectoryPath)
# ---------- python_script.python (12 lines) ----------
path = IN[0]

import sys
sys.path.append(r"C:\Program Files (x86)\IronPython 2.7\Lib")

try:
	import os
	os.startfile(path)
	OUT = "Folder opened"

except:
	OUT = "Link the path of the folder you want to open !"
# ----------------------------------------
OUT = Output(python_script)
